% Requirement links of electricUAV.slx (R2019a)

block :137 implements SystemLevelRequirements.slreqx#6: Flight Data Recorder
block :204 implements SystemLevelRequirements.slreqx#32: Propulsion
block :239 implements SystemLevelRequirements.slreqx#37: Carrying Capacity
block :239 implements SystemLevelRequirements.slreqx#38: Payload Bay Capacirty
block :239 implements SystemLevelRequirements.slreqx#41: Modularity
block :241 implements SystemLevelRequirements.slreqx#41: Modularity
block :285 implements SystemLevelRequirements.slreqx#31: Endurance
block :286 implements SystemLevelRequirements.slreqx#4: Main Power
block :288 implements SystemLevelRequirements.slreqx#5: Payload Power
block :36 implements SystemLevelRequirements.slreqx#7: Flight Controller
block :47 implements SystemLevelRequirements.slreqx#30: Enclosure
block :48 implements SystemLevelRequirements.slreqx#34: Flight Control Link
block :48 implements SystemLevelRequirements.slreqx#3: Range
block :62 implements SystemLevelRequirements.slreqx#39: Default Payload
block :76 implements SystemLevelRequirements.slreqx#35: Payload Data Link
block :81 implements SystemLevelRequirements.slreqx#31: Endurance