% Requirement links of AutopilotControlSystem.slx (R2021a)

block :2953 implements electricUAVReqs.slreqx#30: Waypoint Orbiting
block :3171 implements electricUAVReqs.slreqx#77: WP_GDNC_8: WP Guidance Mode
block :3348 implements electricUAVReqs.slreqx#31: Automatic Return to Land
block :3427 implements electricUAVReqs.slreqx#76: GDNC_8: Transition from Manual to Autonomous Flight
block :3453 implements electricUAVReqs.slreqx#29: Waypoint Traversal
block :3462 implements electricUAVReqs.slreqx#72: WP_GDNC_4: Distance To Waypoint Computation
block :3496 implements electricUAVReqs.slreqx#81: WP_GDNC_10: Selecting a Minimum Path Distance for WP Guidance
block :3497 implements electricUAVReqs.slreqx#82: WP_GDNC_10_1: Selecting L2 Down Path Distance
block :3498 implements electricUAVReqs.slreqx#83: WP_GDNC_10_2: Avoiding Flying Beyond To Waypoint
block :3523 implements electricUAVReqs.slreqx#74: WP_GDNC_6: Frenet Frame Computation
block :3667 implements electricUAVReqs.slreqx#80: WP_GDNC_2_2: WPT Computation when in TO_IP State
block :3667 implements electricUAVReqs.slreqx#78: WP_GDNC_9: To Waypoint Calculation
block :3697 implements electricUAVReqs.slreqx#73: WP_GDNC_5: Turn Lead Time on Waypoint Transition
block :3698 implements electricUAVReqs.slreqx#73: WP_GDNC_5: Turn Lead Time on Waypoint Transition
block :3761::100 implements electricUAVReqs.slreqx#31: Automatic Return to Land
block :3761::1336:120 implements electricUAVReqs.slreqx#75: WP_GDNC_7: Initial Point Computation
block :3761::1336:128 implements electricUAVReqs.slreqx#80: WP_GDNC_2_2: WPT Computation when in TO_IP State
block :3761::1336:128 implements electricUAVReqs.slreqx#78: WP_GDNC_9: To Waypoint Calculation
block :3761::1336:140 implements electricUAVReqs.slreqx#73: WP_GDNC_5: Turn Lead Time on Waypoint Transition
block :3761::1336:141 implements electricUAVReqs.slreqx#73: WP_GDNC_5: Turn Lead Time on Waypoint Transition
block :3761::1336:42 implements electricUAVReqs.slreqx#81: WP_GDNC_10: Selecting a Minimum Path Distance for WP Guidance
block :3761::1336:43 implements electricUAVReqs.slreqx#82: WP_GDNC_10_1: Selecting L2 Down Path Distance
block :3761::1336:44 implements electricUAVReqs.slreqx#83: WP_GDNC_10_2: Avoiding Flying Beyond To Waypoint
block :3761::1336:66 implements electricUAVReqs.slreqx#74: WP_GDNC_6: Frenet Frame Computation
block :3761::1336:8 implements electricUAVReqs.slreqx#72: WP_GDNC_4: Distance To Waypoint Computation
block :3761::1360:120 implements electricUAVReqs.slreqx#75: WP_GDNC_7: Initial Point Computation
block :3761::1360:128 implements electricUAVReqs.slreqx#80: WP_GDNC_2_2: WPT Computation when in TO_IP State
block :3761::1360:128 implements electricUAVReqs.slreqx#78: WP_GDNC_9: To Waypoint Calculation
block :3761::1360:140 implements electricUAVReqs.slreqx#73: WP_GDNC_5: Turn Lead Time on Waypoint Transition
block :3761::1360:141 implements electricUAVReqs.slreqx#73: WP_GDNC_5: Turn Lead Time on Waypoint Transition
block :3761::1360:42 implements electricUAVReqs.slreqx#81: WP_GDNC_10: Selecting a Minimum Path Distance for WP Guidance
block :3761::1360:43 implements electricUAVReqs.slreqx#82: WP_GDNC_10_1: Selecting L2 Down Path Distance
block :3761::1360:44 implements electricUAVReqs.slreqx#83: WP_GDNC_10_2: Avoiding Flying Beyond To Waypoint
block :3761::1360:66 implements electricUAVReqs.slreqx#74: WP_GDNC_6: Frenet Frame Computation
block :3761::1360:8 implements electricUAVReqs.slreqx#72: WP_GDNC_4: Distance To Waypoint Computation
block :3761::205 implements electricUAVReqs.slreqx#29: Waypoint Traversal
block :3761::861 implements electricUAVReqs.slreqx#30: Waypoint Orbiting
block :3869 implements electricUAVReqs.slreqx#47: Trim Conditions Capture
block :3878 implements electricUAVReqs.slreqx#45: CTRL_3: Turnrate Controller
block :3878 implements electricUAVReqs.slreqx#58: CTRL_4: Yaw Damper
block :3893 implements electricUAVReqs.slreqx#66: YD_2: Trim Position Contribution to Altitude Controller
block :3895 implements electricUAVReqs.slreqx#63: BAHOLD_2: Trim Position Contribution to Altitude Controller
block :3896 implements electricUAVReqs.slreqx#62: BAHOLD_1: Aileron Command Saturation
block :3985 implements electricUAVReqs.slreqx#65: YD_1: Rudder Command Saturation
block :4077 implements electricUAVReqs.slreqx#44: Altitude Controller
block :4077 implements electricUAVReqs.slreqx#43: Airspeed Controller
block :4095 implements electricUAVReqs.slreqx#56: Trim Position Contribution to Airspeed Controller
block :4098 implements electricUAVReqs.slreqx#52: Trim Position Contribution to Altitude Controller
block :4205 implements electricUAVReqs.slreqx#50: Elevator Command Saturation
block :4209 implements electricUAVReqs.slreqx#51: Altitude Controller Anti-Windup Protection
block :4209 implements electricUAVReqs.slreqx#53: HHOLD_3: Pitch Command Saturation
block :4368 implements electricUAVReqs.slreqx#48: Rate-Limit Altitude Command
block :4368 implements electricUAVReqs.slreqx#49: Altitude Rate Limiter's Initial Conditions
block :4399 implements electricUAVReqs.slreqx#54: Throttle Command Saturation
block :4763 implements electricUAVReqs.slreqx#40: Filtering
block :4769 implements electricUAVReqs.slreqx#40: Filtering
block :4770 implements electricUAVReqs.slreqx#40: Filtering
block :4777 implements electricUAVReqs.slreqx#40: Filtering
block :4778 implements electricUAVReqs.slreqx#40: Filtering
block :4779 implements electricUAVReqs.slreqx#40: Filtering
block :4933 implements electricUAVReqs.slreqx#59: GDNC_5: Maximum Roll Angle Command
block :4958 implements electricUAVReqs.slreqx#59: GDNC_5: Maximum Roll Angle Command
block :4959 implements electricUAVReqs.slreqx#69: WP_GDNC_1: Enabling WP Guidance
block :4959 implements electricUAVReqs.slreqx#70: WP_GDNC_2: Reaching Initial Point in Wayoint Path
block :4959 implements electricUAVReqs.slreqx#71: WP_GDNC_3: Transition to Next Waypoint
block :4959 implements electricUAVReqs.slreqx#79: WP_GDNC_3_1: Wrapping Around the Waypoint Sequence
block :5031 implements electricUAVReqs.slreqx#55: Airspeed Controller Anti-Windup Protection
block :5106 implements electricUAVReqs.slreqx#68: YD_4: Lateral Acceleration Filtering
block :5178 implements electricUAVReqs.slreqx#64: BAHOLD_5: Roll Angle Controller Anti-Windup Protection
block :5250 implements electricUAVReqs.slreqx#67: YD_3: Roll Angle Controller Anti-Windup Protection
block :5275 implements electricUAVReqs.slreqx#39: Temperature Compensation
block :5290 implements electricUAVReqs.slreqx#49: Altitude Rate Limiter's Initial Conditions
block :5307 implements electricUAVReqs.slreqx#75: WP_GDNC_7: Initial Point Computation
block :5390:120 implements electricUAVReqs.slreqx#75: WP_GDNC_7: Initial Point Computation
block :5390:128 implements electricUAVReqs.slreqx#80: WP_GDNC_2_2: WPT Computation when in TO_IP State
block :5390:128 implements electricUAVReqs.slreqx#78: WP_GDNC_9: To Waypoint Calculation
block :5390:140 implements electricUAVReqs.slreqx#73: WP_GDNC_5: Turn Lead Time on Waypoint Transition
block :5390:141 implements electricUAVReqs.slreqx#73: WP_GDNC_5: Turn Lead Time on Waypoint Transition
block :5390:42 implements electricUAVReqs.slreqx#81: WP_GDNC_10: Selecting a Minimum Path Distance for WP Guidance
block :5390:43 implements electricUAVReqs.slreqx#82: WP_GDNC_10_1: Selecting L2 Down Path Distance
block :5390:44 implements electricUAVReqs.slreqx#83: WP_GDNC_10_2: Avoiding Flying Beyond To Waypoint
block :5390:66 implements electricUAVReqs.slreqx#74: WP_GDNC_6: Frenet Frame Computation
block :5390:8 implements electricUAVReqs.slreqx#72: WP_GDNC_4: Distance To Waypoint Computation
block :5438 implements electricUAVReqs.slreqx#76: GDNC_8: Transition from Manual to Autonomous Flight