# Requirement set SystemLevelRequirements (R2019a)

## 1 [#1] Aircraft (Container)

### 1.1 [#2] Airworthiness (Container)

#### 1.1.1 [#3] Range (Informational)
The aircraft shall be controllable for all distances within visual line-of-sight

#### 1.1.2 [#4] Main Power
Aircraft shall provide battery power to all onboard flight critical systems for the complete duration of the flight

#### 1.1.3 [#5] Payload Power
Aircraft shall provide battery power for payload and its data link independent of Main Power for the complete duration of the flight

#### 1.1.4 [#6] Flight Data Recorder
Aircraft shall provide the means to record all flight data from every component on board for the duration of the flight

#### 1.1.5 [#7] Flight Controller
Aircraft shall provide an off-the-shelof flight computer to autonomously control the aircraft from launch to recovery

##### 1.1.5.1 [#30] Enclosure
Fight computer shall be contained in an enclosure for its protection and easy connectivity to the necessary devices

#### 1.1.6 [#31] Endurance (Informational)
The aircraft shall be able to sustain uninterrupted flights for up to one hour

#### 1.1.7 [#32] Propulsion
The aircraft's shall employ an off-the-shelf electric BLDC motor approriate to the MTOW

### 1.2 [#33] Communications (Container)

#### 1.2.1 [#34] Flight Control Link
Aircraft shall provide a dedicated and permanent communications link with its ground station for command and control for all the range of operations.

#### 1.2.2 [#35] Payload Data Link
Aircraft shall provide a dedicated and permanent payload data link for all the range of operations

### 1.3 [#36] Payload Capabilities (Container)

#### 1.3.1 [#37] Carrying Capacity
Aircraft shall be able to carry up to 250 grams of payload

#### 1.3.2 [#38] Payload Bay Capacirty
Aircraft shall provide a payload bay with at least 10,000 mm^3

#### 1.3.3 [#39] Default Payload
Aircraft shall provide a pre-installed payload in the form a a gimbal-stabilized action camera providing Full-Motion video in high-definition video .

### 1.4 [#40] Construction (Container)

#### 1.4.1 [#41] Modularity
Aircraft shall be constrocuted in modular components for easy spare part procurement and replacement

#### 1.4.2 [#42] Assembly/Disassembly Time
Aircraft shall be able to be assembled and dissambled by a two person team within 10 minutes.

### 1.5 [#43] Transportation (Container)

#### 1.5.1 [#44] Transportation Case Weight
Aircraft shall fit in a transportation case whose weight does not exceed 10 Kg.