test file "AutopilotControlSystem_test1"
  setup callback:
    base_workspace_set_up();
  coverage: Decision, MCDC, SignalRange, Condition, LookupTable, SaturationOnIntOverflow

suite "Baseline Tests"
  tags: github

  case "MIL Baseline Test" [baseline]
    model AutopilotControlSystem, mode Normal
    input "inputs_on_2021_08_17_at_08_10_16.mat", mapped to uavMission, gsCommands, apConfigParams, RawSensorData, GPSData (active)
    post-load callback:
      models_set_up(eTask.FlightControllerDesign,false);
    baseline "baselineAutopilotControlSystem.mat": rel tol 0.01
      U_c
      h_c
      phi_c
      Add1:1
      Add4:1
      theta_c
      Ab
      G
      Euler
      ias
      baro
      Xe
      Ve
      gps_latLon
      gps_h
      gps_cog
      gps_sog
      gps_fix
      guidanceMode
      currentWp
      elevatorCmd
      throttleCmd
      aileronCmd
      rudderCmd
      flapCmd
    assessment "Pitch": At any point of time, pitch_command must be greater than or equal to -35*deg2rad and less than or equal to 35*deg2rad
    assessment "Throttle": At any point of time, throttle_command must be greater than or equal to 0 and less than or equal to 95
    assessment "Elevator": At any point of time, elevator_command must be greater than or equal to -23*deg2rad and less than or equal to 23*deg2rad
      pitch_command: signal AutopilotControlSystem/InnerLoopAutopilot/Longitudinal Channel/Height Error to Pitch Command [PI], port 1
      throttle_command: signal AutopilotControlSystem/InnerLoopAutopilot/Longitudinal Channel/Add1, port 1
      elevator_command: signal AutopilotControlSystem/InnerLoopAutopilot/Longitudinal Channel/Add4, port 1
      deg2rad: expression pi/180

suite "B2B Equivalence Tests"

  case "B2B MIL SIL Equivalence" [equivalence]
    simulation 1:
      model AutopilotControlSystem, mode Normal
      input "inputs_on_2021_08_17_at_08_10_16.mat", mapped to uavMission, gsCommands, apConfigParams, RawSensorData, GPSData (active)
    simulation 2:
      model AutopilotControlSystem, mode Software-in-the-Loop (SIL)
      input "inputs_on_2021_08_17_at_08_10_16.mat", mapped to uavMission, gsCommands, apConfigParams, RawSensorData, GPSData (active)
    equivalence criteria
      apStatus:1.Ab(1)
      apStatus:1.G(1)
      apStatus:1.Euler(1)
      apStatus:1.ias: rel tol 0.01
      apStatus:1.baro
      apStatus:1.Xe(1)
      apStatus:1.Ve(1): rel tol 0.01
      apStatus:1.GPS.gps_latLon(1)
      apStatus:1.GPS.gps_h
      apStatus:1.GPS.gps_cog
      apStatus:1.GPS.gps_sog
      apStatus:1.GPS.gps_fix
      apStatus:1.guidanceMode
      apStatus:1.currentWp
      CtrlCmds:1.elevatorCmd: rel tol 0.01
      CtrlCmds:1.throttleCmd: rel tol 0.01
      CtrlCmds:1.aileronCmd: rel tol 0.01
      CtrlCmds:1.rudderCmd: rel tol 0.01
      CtrlCmds:1.flapCmd: rel tol 0.01
      apStatus:1.Ab(2)
      apStatus:1.Ab(3)
      apStatus:1.G(2)
      apStatus:1.G(3)
      apStatus:1.Euler(2)
      apStatus:1.Euler(3)
      apStatus:1.Xe(2)
      apStatus:1.Xe(3)
      apStatus:1.Ve(2): rel tol 0.01
      apStatus:1.Ve(3): rel tol 0.01
      apStatus:1.GPS.gps_latLon(2)