% Requirement links of AutopilotControlSystem_test1.mldatx (R2021a)

item 1 verifies electricUAVReqs.slreqx#42: Control
1 verifies electricUAVReqs.slreqx#53: HHOLD_3: Pitch Command Saturation
15 verifies electricUAVReqs.slreqx#50: HHOLD_4: Elevator Command Saturation
8 verifies electricUAVReqs.slreqx#54: UHOLD_1: Throttle Command Limits
1 verifies electricUAVReqs.slreqx#53: HHOLD_3: Pitch Command Saturation
15 verifies electricUAVReqs.slreqx#50: HHOLD_4: Elevator Command Saturation
8 verifies electricUAVReqs.slreqx#54: UHOLD_1: Throttle Command Limits
1 verifies electricUAVReqs.slreqx#53: HHOLD_3: Pitch Command Saturation
15 verifies electricUAVReqs.slreqx#50: HHOLD_4: Elevator Command Saturation
8 verifies electricUAVReqs.slreqx#54: UHOLD_1: Throttle Command Limits
item 11 verifies electricUAVReqs.slreqx#42: Control