test file "regression_tests"
  setup callback:
    base_workspace_set_up();
  cleanup callback:
    bdclose all;

suite "baselineshortFlight"

  case "baselineShortFlight - Guidance SL - AP MIL" [baseline]
    tags: github
    model simModel, mode Normal, stop time 425
    post-load callback:
      models_set_up(eTask.FlightControllerDesign, false);

      % Set Simulink variant for Guidance Logic
      useGuidanceSF = false;
    baseline "baselineShortFlight.mat": rel tol 0.01
      Ab
      G
      Euler
      ias
      baro
      Xe
      Ve
      gps_latLon
      gps_h
      gps_cog
      gps_sog
      gps_fix
      guidanceMode
      currentWp
      U_c
      h_c
      phi_c
      theta_c
      Euler
      pqr
      X_e
      V_e
      A_b
      baro
      q
      OAT
      airspeed
      gps_latLon
      gps_h
      gps_cog
      gps_sog
      gps_fix
      ctrlSurfacePos

  case "baselineShortFlight - Guidance SF - AP MIL" [baseline]
    tags: github
    model simModel, mode Normal, stop time 425
    post-load callback:
      models_set_up(eTask.FlightControllerDesign);

      % Set Stateflow variant for Guidance Logic
      useGuidanceSF = true;
    baseline "baselineShortFlight.mat": rel tol 0.01
      Ab
      G
      Euler
      ias
      baro
      Xe
      Ve
      gps_latLon
      gps_h
      gps_cog
      gps_sog
      gps_fix
      guidanceMode
      currentWp
      U_c
      h_c
      phi_c
      theta_c
      Euler
      pqr
      X_e
      V_e
      A_b
      baro
      q
      OAT
      airspeed
      gps_latLon
      gps_h
      gps_cog
      gps_sog
      gps_fix
      ctrlSurfacePos

  case "baselineShortFlight - Guidance SL - AP SIL" [baseline]
    model simModel, mode Normal, stop time 425
    post-load callback:
      models_set_up(eTask.TestAutopilotCodeOffline);

      % Set Simulink variant for Guidance Logic
      useGuidanceSF = false;
    baseline "baselineShortFlight_SIL.mat": abs tol 0.5, rel tol 0.01, leading tol 0.01, lagging tol 0.01
      Ab
      G
      Euler
      ias
      baro
      Xe
      Ve
      gps_latLon
      gps_h
      gps_cog
      gps_sog
      gps_fix
      guidanceMode
      currentWp
      Euler
      pqr
      X_e
      V_e
      A_b
      baro
      q
      OAT
      airspeed
      gps_latLon
      gps_h
      gps_cog
      gps_sog
      gps_fix
      ctrlSurfacePos

  case "baselineShortFlight - Guidance SF - AP SIL" [baseline]
    model simModel, mode Normal, stop time 425
    post-load callback:
      models_set_up(eTask.TestAutopilotCodeOffline);

      % Set Stateflow variant for Guidance Logic
      useGuidanceSF = true;
    baseline "baselineShortFlight_SIL.mat": abs tol 0.5, rel tol 0.01, leading tol 0.01, lagging tol 0.01
      Ab
      G
      Euler
      ias
      baro
      Xe
      Ve
      gps_latLon
      gps_h
      gps_cog
      gps_sog
      gps_fix
      guidanceMode
      currentWp
      Euler
      pqr
      X_e
      V_e
      A_b
      baro
      q
      OAT
      airspeed
      gps_latLon
      gps_h
      gps_cog
      gps_sog
      gps_fix
      ctrlSurfacePos

  case "baselineShortFlight - Accel - Guidance SL - AP MIL" [baseline]
    tags: github
    model simModel, mode Accelerator, stop time 425
    post-load callback:
      models_set_up(eTask.FlightControllerDesign);

      % Set Simulink variant for Guidance Logic
      useGuidanceSF = false;
    baseline "baselineShortFlight_Accel.mat": rel tol 0.01
      Ab
      G
      Euler
      ias
      baro
      Xe
      Ve
      gps_latLon
      gps_h
      gps_cog
      gps_sog
      gps_fix
      guidanceMode
      currentWp
      U_c
      h_c
      phi_c
      theta_c
      Euler
      pqr
      X_e
      V_e
      A_b
      baro
      q
      OAT
      airspeed
      gps_latLon
      gps_h
      gps_cog
      gps_sog
      gps_fix
      ctrlSurfacePos

  case "baselineShortFlight - Accel - Guidance SF - AP MIL" [baseline]
    tags: github
    model simModel, mode Accelerator, stop time 425
    post-load callback: same code as in post-load callback of case "baselineShortFlight - Guidance SF - AP MIL"
    baseline "baselineShortFlight_SF_Accel.mat": rel tol 0.01
      Ab
      G
      Euler
      ias
      baro
      Xe
      Ve
      gps_latLon
      gps_h
      gps_cog
      gps_sog
      gps_fix
      guidanceMode
      currentWp
      U_c
      h_c
      phi_c
      theta_c
      Euler
      pqr
      X_e
      V_e
      A_b
      baro
      q
      OAT
      airspeed
      gps_latLon
      gps_h
      gps_cog
      gps_sog
      gps_fix
      ctrlSurfacePos

  case "baselineShortFlight - RSIM - Guidance SL - AP MIL" [baseline]
    tags: github
    model simModel, mode Rapid Accelerator, stop time 425
    post-load callback: same code as in post-load callback of case "baselineShortFlight - Accel - Guidance SL - AP MIL"
    baseline "baselineShortFlight_Accel.mat": rel tol 0.01
      Ab
      G
      Euler
      ias
      baro
      Xe
      Ve
      gps_latLon
      gps_h
      gps_cog
      gps_sog
      gps_fix
      guidanceMode
      currentWp
      U_c
      h_c
      phi_c
      theta_c
      Euler
      pqr
      X_e
      V_e
      A_b
      baro
      q
      OAT
      airspeed
      gps_latLon
      gps_h
      gps_cog
      gps_sog
      gps_fix
      ctrlSurfacePos

  case "baselineShortFlight - RSIM - Guidance SF - AP MIL" [baseline]
    tags: github
    model simModel, mode Rapid Accelerator, stop time 425
    post-load callback: same code as in post-load callback of case "baselineShortFlight - Guidance SF - AP MIL"
    baseline "baselineShortFlight_SF_Accel.mat": rel tol 0.01
      Ab
      G
      Euler
      ias
      baro
      Xe
      Ve
      gps_latLon
      gps_h
      gps_cog
      gps_sog
      gps_fix
      guidanceMode
      currentWp
      U_c
      h_c
      phi_c
      theta_c
      Euler
      pqr
      X_e
      V_e
      A_b
      baro
      q
      OAT
      airspeed
      gps_latLon
      gps_h
      gps_cog
      gps_sog
      gps_fix
      ctrlSurfacePos

suite "CodeGen and Build Tests"

  case "raspiAutopilotControlSystem - CodeGen" [simulation] (disabled)
    model raspiAutopilotControlSystem, mode Normal, stop time 0
    post-load callback:
      models_set_up(eTask.SystemIntegrationTest);

      % Build model
      slbuild(sltest_bdroot,'generateCodeOnly',true,'IncludeModelReferenceSimulationTargets',true);

  case "slrtPlantModel - Build" [simulation]
    model slrtPlantModel, mode Normal, stop time 0
    post-load callback:
      models_set_up(eTask.SystemIntegrationTest);

      % Workaround for IP settings on desktop
      sgIP = '0.0.0.0';

      % Build model
      slbuild(sltest_bdroot,'generateCodeOnly',false,'IncludeModelReferenceSimulationTargets',true);

suite "Models and scripts"

  case "Co-Simulation - Update" [simulation]
    tags: github
    model simModel, mode Normal, stop time 0
    post-load callback:
      models_set_up(eTask.UAVSMECapabilities);

  case "Run Short Flight - Dummy test" [simulation]
    tags: github
    model simModel, stop time 0
    post-load callback:
      models_set_up(eTask.FlightControllerDesign);

      runShortFlight(sltest_bdroot,5);

  case "Local Parallel Simulation - Dummy test" [simulation]
    model simModel, mode Normal, stop time 0
    post-load callback:
      models_set_up(eTask.TestFlightController);

      runparsim(1, 5, 'local');
    cleanup callback:
      delete(gcp('nocreate'));